# Grasshopper definition prediction.gh (Grasshopper 1.0.7)
# plug-ins: MeshEdit Components

rectangle = Rectangle(Plane=PlaneXY(0, 0, 0), XSize=Slider(3.6, range=3.6..8.4), YSize=Slider(7.3, range=3.6..8.4), Radius=0)  # -> Rectangle, Length

# ---- group: Define Room
win_heigth = Slider(2, range=1.5..3)  # disabled
win_count = Slider(2, range=1..3)  # disabled
win_width = Slider(2, range=0..10)  # disabled
win_sill = Slider(0.9, range=0.5..1.5)  # disabled
height = Slider(3.2, range=0..10)  # disabled
room_boundary = Curve(<curve referenced from the Rhino model>)  # disabled
win_direction = Line(Line((113, -44, 0), (113, -52, 0)))  # disabled
define_room = DefineRoom(B=room_boundary, H=height, vec=win_direction, width=win_width, height=win_heigth, sill_height=win_sill, nwin=win_count)  # disabled

win_heigth_2 = Slider(2.1, range=1.5..3)
win_width_2 = Slider(2.2, range=0..10)
win_count_2 = Slider(1, range=1..3)
win_sill_2 = Slider(0.7, range=0.5..1.5)
height_2 = Slider(3.2, range=0..10)
room_boundary_2 = Curve(rectangle.Rectangle)
win_direction_2 = Line(Line((0.8962087146, 0.8211059089, 0), (0.4833957581, -11.01261894, 0)))
define_room_2 = DefineRoom(
    B=room_boundary_2,
    H=height_2,
    vec=win_direction_2,
    width=win_width_2,
    height=win_heigth_2,
    sill_height=win_sill_2,
    nwin=win_count_2)

win_heigth_3 = Slider(2, range=1.5..3)  # disabled
win_width_3 = Slider(2, range=0..10)  # disabled
win_count_3 = Slider(3, range=1..3)  # disabled
win_sill_3 = Slider(0.9, range=0.5..1.5)  # disabled
height_3 = Slider(3.2, range=0..10)  # disabled
room_boundary_3 = Curve(<curve referenced from the Rhino model>)  # disabled
win_direction_3 = Line(Line((91, -38, 0), (91, -30, 0)))  # disabled
define_room_3 = DefineRoom(
    B=room_boundary_3,
    H=height_3,
    vec=win_direction_3,
    width=win_width_3,
    height=win_heigth_3,
    sill_height=win_sill_3,
    nwin=win_count_3)  # disabled

win_heigth_4 = Slider(2, range=1.5..3)  # disabled
win_width_4 = Slider(2, range=0..10)  # disabled
win_count_4 = Slider(1, range=1..3)  # disabled
win_sill_4 = Slider(0.9, range=0.5..1.5)  # disabled
height_4 = Slider(3.2, range=0..10)  # disabled
room_boundary_4 = Curve(<curve referenced from the Rhino model>)  # disabled
win_direction_4 = Line(Line((113, -44, 0), (113, -52, 0)))  # disabled
define_room_4 = DefineRoom(
    B=room_boundary_4,
    H=height_4,
    vec=win_direction_4,
    width=win_width_4,
    height=win_heigth_4,
    sill_height=win_sill_4,
    nwin=win_count_4)  # disabled

# ---- group: Parse Data
merge = Merge(Data1=define_room_4, Data2=define_room_2, Data3=define_room, Data4=define_room_3)
demodel = ExplodeTree(Data=merge)  # -> simplify(graft(Branch0)), simplify(graft(Branch1)), simplify(graft(Branch2)), Branch3
preview = CustomPreview(Geometry=demodel.Branch1, Material=ColourSwatch(SwatchColor=RGBA(142, 198, 209, 131)))
preview_2 = CustomPreview(Geometry=demodel.Branch0, Material=ColourSwatch(SwatchColor=RGBA(219, 219, 219, 112)))

# ---- group: prediciton / load model in cuurent directory
model_path = GhPythonScript()  # -> ms
# ---------- model_path: Python ----------
__author__ = "ForestoShen"
__version__ = "2021.09.11"


import glob
import os

path = ghenv.Component.OnPingDocument().FilePath
dir = os.path.split(path)
ms = glob.glob(dir[0]+"/*.h5")
# ---------- end model_path ----------

# ---- group: prediciton
grid_size = Slider(0.1, range=0..1)
list = ValueList({"UDIn": 0, "UDIs": 1, "UDIa": 2, "UDIx": 3, "UDI": 4, "DA": 5}, selected="UDIa")
partition = PartitionList(List=demodel.Branch3, Size=8)  # -> simplify(Chunks)
item = ListItem(List=partition, Index=0, Wrap=True)  # -> Item, Item1
division = Division(A=item.Item, B=grid_size)
division_2 = Division(A=item.Item1, B=grid_size)
round = Round(Number=division_2)  # -> Nearest, Floor, Ceiling
round_2 = Round(Number=division)  # -> Nearest, Floor, Ceiling
int = Integer(round.Nearest)
int_2 = Integer(round_2.Nearest)
ins = InsertItems(List=partition, Item=[int_2, int], Indices=7, Wrap=True)
predict = PredictWithTrainedModel(model_path=model_path, port=Slider(666, range=0..1000), run=Toggle(False), X=ins)  # -> out, res; inputs model_path: list, port: Int32, run: Boolean, X: tree
# ---------- predict: Python ----------
ghenv.Component.Name = "predict with trained model"
ghenv.Component.NickName = 'predict'
#ghenv.Component.IconDisplayMode = ghenv.Component.IconDisplayMode.application
ghenv.Component.Category = "Tensorfly"
ghenv.Component.SubCategory = "core"
ghenv.Component.Description = 'run the dl model and get the result'
ghenv.Component.Message = "run a server model"


import subprocess
import os.path
import scriptcontext as sc

_model_path = [p.replace('\\','/') for p in _model_path]
working_dir = '/'.join(_model_path[0].split('/')[:-1])
serverfile = working_dir + "/server.py"

tempfile = working_dir + "/temp.txt"
resfile = working_dir + "/res.txt"

server = """
import time
import sys
import joblib
from keras.models import load_model
import keras.backend as K
from xmlrpc.server import SimpleXMLRPCServer
import traceback
import numpy as np

def R_squared(y, y_pred):
    res =  K.sum(K.square(y - y_pred)) 
    tot = K.sum(K.square(y - K.mean(y))) 
    return ( 1 - res/(tot + K.epsilon()) )
def prmse(y, y_pred):
    rmse = K.mean(K.square(y-y_pred))**0.5
    Tmav = K.mean(y)
    return rmse/Tmav*100

try:
    print(r'loading model')
    model_path = {path}
    models=[load_model(p,custom_objects={{"R_squared":R_squared,"prmse":prmse}}) for p in model_path]
except Exception as e:
    print(e)
    print(r'loading model FAIL')


scalers=[joblib.load(p+'.scalar') for p in model_path]
def predict_resolution(X):
    X=X.reshape([-1,X.shape[-1]])
    idx=int(X[:,-1].mean())-1
    X = X[:,:-1]
    rx=int(X[:,-2].mean())
    ry=int(X[:,-1].mean())
    sx=1/rx
    sy=1/ry
    row_num=X.shape[0]
    inputs=np.zeros([rx*ry,2])
    for ix in range(rx):
        for iy in range(ry):
            inputs[ix*ry+iy] = np.array([sx*ix+sx/2,sy*iy+sy/2])
    inputs=np.tile(inputs,[row_num,1])
    fullinput = np.hstack([np.repeat(X[:,:-2],rx*ry,0),inputs])
    return models[idx].predict(scalers[idx].transform(fullinput)).transpose().flatten()

def predict():
    try:
        #v=np.loadtxt(r"{tempfile}",delimiter=',',dtype=float)
        #if len(v.shape)==1: v=np.expand_dims(v, axis=0)
        #res=np.apply_along_axis(predict_resolution,1,v)
        res=[]
        with open(r"{resfile}",'w+') as outf:
            with open(r"{tempfile}",'r') as f:
                for l in f:
                    inp = np.array([float(d) for d in l.split(",")])
                    outp= predict_resolution(inp).tolist()
                    res.append(outp)
                    outf.write(",".join([str(p) for p in outp]))
                    outf.write("\\n")
        #np.savetxt(r"{resfile}",res,fmt="%.1f")
        return r"{resfile}"
    except Exception as e:
        print(e)
        traceback.print_exc()
    #print('predict:', res)

def execute(cmd):
    exec(cmd)
def check():
    print('server start!')
    return True
server = SimpleXMLRPCServer(("127.0.0.1", {port}))
print ("Listening on port {port}...")
server.register_function(predict, "predict")
server.register_function(execute, "execute")
server.register_function(check, "check")
server.serve_forever()
print('server start!')
""".format(path=str(_model_path), port = port or 3378,tempfile=tempfile,resfile=resfile)
import xmlrpclib
import time

if run and _model_path:
    with open(serverfile,'w+') as f:
        f.write(server)
    #get connection if first time
    
    if 'popen' not in globals() or popen.poll() != None:
        
        popen = subprocess.Popen(['python', 'server.py'],cwd = working_dir)
        proxy = xmlrpclib.ServerProxy("http://127.0.0.1:%d/"%(port or 3378))
        while popen.poll() is None:
            try:
                finsih = proxy.check()
            except Exception as e:
                print e
                time.sleep(1)
                continue
            break
    if X.BranchCount>0:
        with open(tempfile,'w+') as f:
            for br in X.Branches:
                f.write(",".join(str(i) for i in br))
                f.write("\n")
        predict = proxy.predict()
        res=[]
        with open(resfile,'r') as f:
            res=f.readlines()
    ghenv.Component.Message = "running , please send input"
else:
    if 'popen' in globals():
        popen.kill()
# ---------- end predict ----------
python = GhPythonScript(UDI=predict.res, T=list)  # -> simplify(output); inputs UDI: list, T: Int32
# ---------- python: Python ----------
__author__ = "ForestoShen"
__version__ = "2019.07.28"
import Grasshopper.Kernel.Data.GH_Path as Path
import Grasshopper.DataTree as DataTree

from Grasshopper.Kernel.Types import GH_Number

output=DataTree[GH_Number]()
UDIS=[[GH_Number(float(s)) for s in d.split(",")] for d in UDI]

for i,UDI in enumerate(UDIS):
    n=int(len(UDI)/4)
    UDIn = UDI[:n]
    UDIs = UDI[n:2*n]
    UDIa = UDI[2*n:3*n]
    UDIx = UDI[3*n:4*n]
    udi = [GH_Number(a.Value + b.Value) for a, b in zip(UDIs, UDIa)]
    df = [GH_Number(a.Value + b.Value) for a, b in zip(UDIx, UDIa)]
    d = {0:UDIn,1:UDIs,2:UDIa,3:UDIx,4:udi,5:df}
    output.AddRange(d[T],Path(i))
# ---------- end python ----------

# ---- group: Visulaization
rec = Rectangle(demodel.Branch2)
flip = FlipCurve(Curve=rec)  # -> Curve, Flag
data = Data(python)
mplane = MeshPlane(Boundary=flip.Curve, WidthCount=int, HeightCount=int_2)  # -> Mesh, Area
gradient = Gradient(
    LowerLimit=Slider(0, range=0..100),
    UpperLimit=Slider(100, range=0..100),
    Parameter=data,
    stops=[0: RGB(75, 107, 169), 0.219: RGB(173, 203, 249), 0.5: RGB(254, 244, 84), 0.767: RGB(234, 126, 0), 1: RGB(234, 38, 0)])
move = Move(Geometry=mplane.Mesh, Motion=Vector(0, 0, 0.8))  # -> Geometry, Transform
explode = MeshExplode(Mesh=move.Geometry, Interpolate=False)
mcol = MeshColours(Mesh=graft(explode), Colours=graft(gradient))  # -> simplify(Mesh)
result = MeshJoin(Meshes=flatten(mcol))

# ----
panel = Panel(python)

# ==== cluster DefineRoom
B = ClusterInput()
H = ClusterInput()
vec = ClusterInput()
flip = FlipCurve(Curve=graft(B), Guide=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)  # -> Curve, Flag
pcen = PolygonCenter(Polyline=flip.Curve)  # -> CenterV, CenterE, CenterA
explode = Explode(Curve=flip.Curve, Recursive=True)  # -> Segments, Vertices
line = LineSDL(Start=pcen.CenterA, Direction=vec, Length=1)
ivray = IsoVistRay(Sample=line, Radius=100, Obstacles=explode.Segments)  # -> Point, Distance, Index
item = ListItem(List=explode.Segments, Index=expr("x+1", ivray.Index), Wrap=True)
item_2 = ListItem(List=explode.Segments, Index=ivray.Index, Wrap=True)
end = EndPoints(Curve=item_2)  # -> Start, End
end_2 = EndPoints(Curve=item)  # -> Start, End
rec_3pt = Rectangle3Pt(PointA=end.Start, PointB=end.End, PointC=end_2.End)  # -> Rectangle, Length
len = Length(Curve=item)
len_2 = Length(Curve=item_2)
Z = UnitZ(Factor=H)
boundary = BoundarySurfaces(Edges=rec_3pt.Rectangle)
width = ClusterInput()
sill_height = ClusterInput()
nwin = ClusterInput()
height = ClusterInput()
extr = Extrude(Base=boundary, Direction=Z)
W = Number(simplify(len_2))
D = Number(simplify(len))
debrep = DeconstructBrep(Brep=extr)  # -> Faces, Edges, Vertices
cull_i = CullIndex(List=debrep.Faces, Indices=[0, -1], Wrap=True)  # -> simplify(List)
multiplication = Multiplication(Width=width, B=nwin)
division = Division(Height=height, B=H)
division_2 = Division(Sill=sill_height, B=H)
cull_i_2 = CullIndex(List=cull_i, Indices="0", Wrap=True)  # -> simplify(List)
item_3 = ListItem(List=debrep.Faces, Index=0, Wrap=True)  # -> simplify(Item1), simplify(Item)
item_4 = ListItem(List=cull_i, Index="0", Wrap=True)  # -> simplify(Item)
division_3 = Division(A=multiplication, B=W)
rx = Number(division_3)
rys = Number(division_2)
ry = Number(division)
multi_windows = MultiWindows(S=item_4, N=nwin, rx=rx, ry=ry, sy=rys)
evalsrf = EvaluateSurface(Surface=reparameterize(item_4), Point=Point(0.5, 0.5, 0))  # -> Point, Normal, UDirection, VDirection, Frame
Z_2 = UnitZ(Factor=1)
ssimplify = SuperSimplify(T=cull_i_2)  # -> S; inputs T: tree
# ---------- ssimplify: C# ----------
    T.SimplifyPaths();
    S = T;
# ---------- end ssimplify ----------
neg = Negative(Value=Z_2)
Y = UnitY(Factor=-1)
pl = PlaneNormal(Origin=Point(0, 0, 0), ZAxis=neg)
angle = Angle(VectorA=evalsrf.Normal, VectorB=Y, Plane=pl)  # -> Angle, Reflex
deg = Degrees(Radians=angle.Angle)  # -> simplify(flatten(Degrees))
tag = TextTag3D(Location=evalsrf.Point, Text=deg, Size=1, Justification=7)
vdisex = VectorDisplayEx(Point=evalsrf.Point, Vector=evalsrf.Normal, Colour=RGB(0, 0, 0), Width=2)
crossref = CrossReference(ListA=W, ListB=D, ListC=H, ListD=rx, ListE=ry, ListF=rys, ListG=deg, ListH=nwin, CrossMode=4)  # -> ListA, ListB, ListC, ListD, ListE, ListF, ListG, ListH
merge = Merge(
    Data1=crossref.ListA,
    Data2=crossref.ListB,
    Data3=crossref.ListC,
    Data4=crossref.ListD,
    Data5=crossref.ListE,
    Data6=crossref.ListF,
    Data7=crossref.ListG,
    Data8=crossref.ListH)

srfsplit = SurfaceSplit(Surface=item_4, Curves=multi_windows)
split = SplitList(List=srfsplit, Index=1)  # -> ListA, ListB
ssimplify_2 = SuperSimplify(T=[item_3.Item1, item_3.Item])  # -> S; inputs T: tree; same code as ssimplify

ssimplify_3 = SuperSimplify(T=split.ListA)  # -> S; inputs T: tree; same code as ssimplify

merge_2 = Merge(Data1=simplify(ssimplify_2), Data2=simplify(ssimplify), Data3=simplify(ssimplify_3))
join = BrepJoin(Breps=merge_2)  # -> Breps, Closed

entwine = Entwine(Branch00=join.Breps, Branch01=split.ListB, Branch02=rec_3pt.Rectangle, Branch03=merge, FlattenInputs=True)
R = ClusterOutput(entwine)

# ==== cluster MultiWindows
S = ClusterInput()
ry = ClusterInput()
sy = ClusterInput()
N = ClusterInput()
rx = ClusterInput()
addition = Addition(A=ry, B=sy)
divide_domain = GhPythonScript(rx=rx, n=N)  # -> domain; inputs n: Int32
# ---------- divide_domain: Python ----------
__author__ = "forest_hell"
__version__ = "2019.08.01"

import rhinoscriptsyntax as rs
from Grasshopper.Kernel.Types import GH_Interval
from Rhino.Geometry import Interval
singler = rx/n

gap = (1-rx)/(n+1)
domain=[]
for i in range(n):
    d=Interval(i*(gap+singler)+gap,(i+1)*(gap+singler))
    domain.append(d)
# ---------- end divide_domain ----------
dom = ConstructDomain(DomainStart=sy, DomainEnd=addition)
dom² = ConstructDomain²(DomainU=dom, DomainV=divide_domain)
subsrf = Isotrim(Surface=reparameterize(S), Domain=dom²)
flip = Flip(Surface=subsrf)  # -> Surface, Result
S_2 = ClusterOutput(flip.Surface)
