# Grasshopper definition Voxel_sim_gan.gh (Grasshopper 1.0.7)
# plug-ins: Octopus

# ---- group: Randomly genrated voxel data
number_slider = Slider(1234, range=0..10000)
resolution = Slider(16, range=0..100)
python = GhPythonScript(res=resolution, seed=number_slider)  # -> simplify(a), xcount, ycount, zcount; inputs res: Int32
# ---------- python: Python ----------
__author__ = "ForestoShen"
__version__ = "2021.09.01"

import rhinoscriptsyntax as rs
import random
import ghpythonlib.treehelpers as tree

random.seed(seed)

x = y = z = res
a = [[[random.randint(0, 1) for ix in range(x)] for iy in range(y)] for iz in range(z)]
a = tree.list_to_tree(a)

data = "1001000000000110"
# data is a string composed of 01
zcount = x
ycount = y
xcount = z
# ---------- end python ----------
flatten = FlattenTree(Tree=python.a, Path="{0}")
join = TextJoin(Text=flatten)

# ----
gan_model = FilePath()
input_noise = Number()
resolution_2 = Slider(32, range=0..100)
# Directly connect 3d gan via HTTP server
# (need a working local envoriment, and some more coding to make it work)
predict = PredictWithTrainedModel(model_path=gan_model, port=Slider(1234, range=0..10000), X=input_noise)  # -> out, res; inputs model_path: list, port: Int32, run: Boolean, X: tree
# ---------- predict: Python ----------
__author__ = "ForestoShen"
__version__ = "2021.09.01"


ghenv.Component.Name = "predict with trained model"
ghenv.Component.NickName = 'predict'
#ghenv.Component.IconDisplayMode = ghenv.Component.IconDisplayMode.application
ghenv.Component.Category = "Tensorfly"
ghenv.Component.SubCategory = "core"
ghenv.Component.Description = 'run the dl model and get the result'
ghenv.Component.Message = "run a server model"


import subprocess
import os.path
import scriptcontext as sc

_model_path = [p.replace('\\','/') for p in _model_path]
working_dir = '/'.join(_model_path[0].split('/')[:-1])
serverfile = working_dir + "/server.py"

tempfile = working_dir + "/temp.txt"
resfile = working_dir + "/res.txt"

server = """
import time
import sys
import joblib
from keras.models import load_model
import keras.backend as K
from xmlrpc.server import SimpleXMLRPCServer
import traceback
import numpy as np



try:
    print(r'loading model')
    model_path = {path}
    models=[load_model(p,custom_objects={{"R_squared":R_squared,"prmse":prmse}}) for p in model_path]
except Exception as e:
    print(e)
    print(r'loading model FAIL')


def model(X):
    # call trained model here
    # return 0, 1 matrix here
    return
    pass

def predict():
    try:
        res=[]
        with open(r"{resfile}",'w+') as outf:
            with open(r"{tempfile}",'r') as f:
                for l in f:
                    inp = np.array([float(d) for d in l.split(",")])
                    outp = np.flatten(model(inp)).tolist()
                    res.append(outp)
                    outf.write("".join([str(p) for p in outp]))
                    outf.write("\\n")
        #np.savetxt(r"{resfile}",res,fmt="%.1f")
        return r"{resfile}"
    except Exception as e:
        print(e)



def check():
    print('server start!')
    return True

server = SimpleXMLRPCServer(("127.0.0.1", {port}))
print ("Listening on port {port}...")
server.register_function(predict, "predict")
server.register_function(check, "check")
server.serve_forever()
print('server start!')
""".format(path=str(_model_path), port = port or 3378,tempfile=tempfile,resfile=resfile)
import xmlrpclib
import time

if run and _model_path:
    with open(serverfile,'w+') as f:
        f.write(server)
    #get connection if first time
    
    if 'popen' not in globals() or popen.poll() != None:
        
        popen = subprocess.Popen(['python', 'server.py'],cwd = working_dir)
        proxy = xmlrpclib.ServerProxy("http://127.0.0.1:%d/"%(port or 3378))
        while popen.poll() is None:
            try:
                finsih = proxy.check()
            except Exception as e:
                print e
                time.sleep(1)
                continue
            break
    if X.BranchCount>0:
        with open(tempfile,'w+') as f:
            for br in X.Branches:
                f.write(",".join(str(i) for i in br))
                f.write("\n")
        predict = proxy.predict()
        res=[]
        with open(resfile,'r') as f:
            res=f.readlines()
    ghenv.Component.Message = "running , please send input"
else:
    if 'popen' in globals():
        popen.kill()
# ---------- end predict ----------

# ---- group: Read data from file (auto reload on file content change) / Right click "select one exsisting file"
data_file_path = FilePath()

# ---- group: Read data from file (auto reload on file content change)
# Connect tihs to file output to data
file = ReadFile(File=data_file_path, PerLineParse=True)

# ---- group: Decode Voxel data and create mesh in grasshopper
voxel_size_m = Slider(2, range=0..10)
resolution_3 = Integer(resolution)
# Data:string of "0101010" array
# Repersenting flattened voxel data
# 
# Resolution:voxel space resolution e.g. 16x16x16
data = Data(join)
x = Integer(resolution_3)
y = Integer(resolution_3)
z = Integer(resolution_3)
sqgrid = Square(Plane=PlaneXY(0, 0, 0), Size=voxel_size_m, ExtentX=x, ExtentY=y)  # -> Cells, Points
Z = UnitZ(Factor=voxel_size_m)
# Set EPW file path frist!
python_2 = GhPythonScript(data=data, x=x, y=y, z=z)  # -> out, face_list; inputs x: Int32, y: Int32, z: Int32
# ---------- python_2: Python ----------
__author__ = "ForestoShen"
__version__ = "2021.09.02"

import rhinoscriptsyntax as rs
import Rhino.Geometry as rg

import Grasshopper.Kernel.Types.GH_MeshFace as FACE

xcount = x
ycount = y
zcount = z

def decode(data, x, y, z):
    if x<0 or x>=xcount or y<0 or y>=ycount or z<0 or z>=zcount:
        return 0
    index = x + xcount * y + xcount * ycount * z
    return int(data[index])

def voxel2face(x, y, z, dir, sign):
    if sign == 0:
        return []
    xinc = 1
    yinc = xcount+1
    zinc = (xcount+1) * (ycount+1)
    
    a = x + (xcount+1) * y + (xcount+1) * (ycount+1) * z
    face = [a]
    if dir == 0:
        b = a + zinc
        c = a + yinc + zinc
        d = a + yinc
    if dir == 1:
        b = a + xinc
        c = a + zinc + xinc
        d = a + zinc
    if dir == 2:
        b = a + yinc
        c = a + yinc + xinc
        d = a + xinc
    f2 = [b,c,d] if sign > 0 else [d, c, b]
    face.extend(f2)
    f = FACE(face[0], face[1], face[2], face[3])
    return [f]
    
face_list = []

for iz in range(zcount+1):
    for iy in range(ycount+1):
        for ix in range(xcount+1):
            here = decode(data, ix, iy, iz)
            prevx = decode(data, ix-1, iy, iz)
            prevy = decode(data, ix, iy-1, iz)
            prevz = decode(data, ix, iy, iz-1)
            
            signx = here - prevx
            signy = here - prevy
            signz = here - prevz
            #print("voxel: (%d, %d, %d)"%(ix,iy,iz))
            #print(signx)
            face_list.extend(voxel2face(ix,iy,iz,0,signx))
            face_list.extend(voxel2face(ix,iy,iz,1,signy))
            face_list.extend(voxel2face(ix,iy,iz,2,signz))
# ---------- end python_2 ----------
addition = Addition(A=z, B=1)
flip = FlipMatrix(Data=sqgrid.Points)
arrlinear = LinearArray(Geometry=flatten(flip), Direction=Z, Count=addition)  # -> Geometry, Transform
flip_2 = FlipMatrix(Data=arrlinear.Geometry)
pt = Point(flatten(flip_2))
conmesh = ConstructMesh(Vertices=pt, Faces=python_2.face_list)  # -> flatten(Mesh)
unweld = UnweldMesh(Mesh=conmesh, Angle=1.570796327)

# ---- group: Select EPW file here / Right click "select one exsisting file"
epw_file_path = FilePath()

# ---- group: Select EPW file here
open_weather_file = Ladybug_OpenEPWWeatherFile(open=Toggle(False))  # -> epwFile; plug-in component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
importepw = LBImportEPW(epw_file=epw_file_path)  # -> location, dry_bulb_temperature, dew_point_temperature, relative_humidity, wind_speed, wind_direction, direct_normal_rad, diffuse_horizontal_rad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; plug-in component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

# ---- group: Mesh to be simulated
mesh = Mesh(unweld)

# ----
preview = CustomPreview(Geometry=mesh, Material=ColourSwatch(SwatchColor=RGB(194, 194, 194)))

# ---- group: Incident Radiation during Summer
analysisperiod = LBAnalysisPeriod(start_month=Slider(6, range=1..12), start_day=1, start_hour=0, end_month=Slider(9, range=1..12))  # -> period, hoys, dates; plug-in component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
skymatrix = LBCumulativeSkyMatrix(
    location=importepw.location,
    direct_rad=importepw.direct_normal_rad,
    diffuse_rad=importepw.diffuse_horizontal_rad,
    hoys=analysisperiod.hoys)  # -> report, sky_mtx; plug-in component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
toggle = BooleanToggle(True)
incidentradiation = LBIncidentRadiation(sky_mtx=skymatrix.sky_mtx, geometry=flatten(mesh), grid_size=Slider(1, range=0..1), parallel=toggle, run=toggle)  # -> report, points, results, total, mesh, legend, title, int_mtx; plug-in component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
ma = MassAddition(Input=incidentradiation.results)  # -> Result, PartialResults
summer = Number(ma.Result)
summer_2 = Panel(summer)

# ---- group: Incident Radiation during Winter
analysisperiod_2 = LBAnalysisPeriod(start_month=Slider(11, range=1..12), start_day=1, start_hour=0, end_month=Slider(2, range=1..12))  # -> period, hoys, dates; plug-in component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
skymatrix_2 = LBCumulativeSkyMatrix(
    location=importepw.location,
    direct_rad=importepw.direct_normal_rad,
    diffuse_rad=importepw.diffuse_horizontal_rad,
    hoys=analysisperiod_2.hoys)  # -> report, sky_mtx; plug-in component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
rtrad = LBRealTimeIncidentRadiation(int_mtx=incidentradiation.int_mtx, sky_mtx=skymatrix_2.sky_mtx)  # -> results; plug-in component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
ma_2 = MassAddition(Input=rtrad)  # -> Result, PartialResults
winter = Number(ma_2.Result)
winter_2 = Panel(winter)

# ---- group: Incident Radiation during Winter / you can visualize radaition data here
heatmap = LBSpatialHeatmap(values=rtrad, mesh=incidentradiation.mesh)  # -> mesh, legend, title, colors, legend_par; disabled; plug-in component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

# ---- group: Multi objective Optimization using Octopus plugin
neg = Negative(Value=winter)
summer_obj = Number(summer)
winter_obj = Number(neg)
octopus = Octopus(OctopusData_gene=number_slider, OctopusData_obj=[winter_obj, summer_obj])

# ---- group: Write peforamnce data to file / Right click "select one exsisting file"
file_to_be_read_by_unity = FilePath("D:\Desktop\自适应表皮\CODE\data\")

# ---- group: Write peforamnce data to file
merge = Merge(Data1=winter_2, Data2=summer_2)
write_to_file = GhPythonScript(path=file_to_be_read_by_unity, data=merge, write=Toggle(False))  # -> out; inputs data: list, write: Boolean
# ---------- write_to_file: Python ----------
### MIT License ###
"""Provides a scripting component.
    Inputs:
        x: The x script variable
        y: The y script variable
    Output:
        a: The a output variable"""

__author__ = "ForestoShen"
__report__ = "ForestoShen@qq.com"
__version__ = "2020.01.22"


import os

if write:
    with open(path,"w") as f:
        f.write(",".join(data))
        f.write("\n")
# ---------- end write_to_file ----------

# ---- group: using galapagos(choose minimize mode)
addition_2 = Addition(A=summer_obj, B=winter_obj)
galapagos = Galapagos(fitness=addition_2, gene=number_slider)
